# Grasshopper definition app.gh (Grasshopper 1.0.7)
# plug-ins: Hops

number_slider = Slider(33, range=0..100)
# ListInput
panel = Panel("http://127.0.0.1:5000")
# Multifunction
panel_2 = Panel("http://127.0.0.1:5000")
# Networkx
panel_3 = Panel("/createGraph")
# Rhino 3dm
panel_4 = Panel("/createRandomPoints")
number_slider_2 = Slider(5, range=0..10)
panel_5 = Panel("salvador")
concatenate = Concatenate(FragmentA="http://127.0.0.1:5000", FragmentB="/mycomponent")
number_slider_3 = Slider(8, range=0..100)
number_slider_4 = Slider(54.68, range=0..100)
number_slider_5 = Slider(100, range=0..100)
number_slider_6 = Slider(65, range=0..100)
number_slider_7 = Slider(59, range=0..100)
number_slider_8 = Slider(65, range=0..100)
number_slider_9 = Slider(59, range=0..100)
number_slider_10 = Slider(65, range=0..100)
number_slider_11 = Slider(59, range=0..100)
concatenate_2 = Concatenate(FragmentA="http://127.0.0.1:5000", FragmentB=panel_3)
number_slider_12 = Slider(4, range=0..10)
number_slider_13 = Slider(4, range=0..10)
concatenate_3 = Concatenate(FragmentA=panel, FragmentB="/listinput")
concatenate_4 = Concatenate(FragmentA="http://127.0.0.1:5000", FragmentB=panel_4)
concatenate_5 = Concatenate(FragmentA="http://127.0.0.1:5000", FragmentB="/mycomponent")
concatenate_6 = Concatenate(FragmentA="http://127.0.0.1:5000", FragmentB="/listoutput")
concatenate_7 = Concatenate(FragmentA=panel_2, FragmentB="/addition")
concatenate_8 = Concatenate(FragmentA="http://127.0.0.1:5000", FragmentB="/substraction")
concatenate_9 = Concatenate(FragmentA="http://127.0.0.1:5000", FragmentB="/multiplication")
duplicate_data = DuplicateData(Data=Slider(1, range=0..1), Number=Slider(10, range=0..10), Order=True)
panel_6 = Panel("na")
hops = Hops(
    _Path=concatenate_2,
    CountX=number_slider_2,
    CountY=number_slider_2,
    Layout=Slider(1, range=0..10),
    CacheResultsInMemory=True,
    CacheSolveResults=True,
    RemoteDefinitionLocation="http://127.0.0.1:5000/createGraph",
    RemoteSolveVersion=(0, 1, 0),
    ShowInput_Enabled=False,
    ShowInput_Path=True,
    SynchronousSolve=True)  # -> Nodes, Edges
